% Simulink data dictionary tricanter_data.sldd

BusTricInputs = Simulink.Bus()  % Собрано build_data_dictionary, 2026-08-17
  eta_o: double
  d50: double
  x50: double
  eps_s: double
  eps_wd: double
  eps_wf: double
  eps_o: double
  Rw: double
  Ro: double
  Q: double
  dn: double
  C: double

BusTricParams = Simulink.Bus()  % Собрано build_data_dictionary, 2026-08-17
  Rd: double
  Wsc: double
  Lpond: double
  alpha: double
  Lsep: double
  rho_s: double
  rho_w: double
  rho_o: double
  eta_w: double
  mu_s: double
  phi_sed: double
  phi_max: double
  phi_ref: double
  u_conv: double
  bs: double
  bw: double
  rrsb: boolean

BusTricGeo = Simulink.Bus()  % Собрано build_data_dictionary, 2026-08-17
  omega: double
  beta: double
  Lax: double
  L_cone: double
  f_clar: double
  u_ax: double
  r_i: double
  Qo: double
  Qw: double
  has_oil: boolean

BusCake = Simulink.Bus()  % Собрано build_data_dictionary, 2026-08-17
  Rtr: double[25]
  dH: double[25]
  m_cake: double[25]
  m_cake_tot: double
  tau_s: double[25]

BusStreams = Simulink.Bus()  % Собрано build_data_dictionary, 2026-08-17
  mdot_oil: double
  mdot_water: double
  mdot_cake: double
  x_w_in_oil: double
  x_o_in_water: double
  x_s_in_cake: double

BusQuality = Simulink.Bus()  % Собрано build_data_dictionary, 2026-08-17
  U: double
  E_s: double
  E_w: double
  phi_s_out: double
  phi_w_out: double
  phi_s_prof: double[25]
  phi_w_prof: double[25]
  E_s_i: double[25]
  tau_c: double

BusFlags = Simulink.Bus()  % Собрано build_data_dictionary, 2026-08-17
  bal_resid: double
  M_scroll: double
  f_oil_collapse: boolean
  f_water_collapse: boolean
  f_overload: boolean
  f_overfill: boolean

BusTricOut = Simulink.Bus()  % Собрано build_data_dictionary, 2026-08-17
  cake: Bus: BusCake
  streams: Bus: BusStreams
  quality: Bus: BusQuality
  flags: Bus: BusFlags

TricParams = Simulink.Parameter(struct(
  Rd=0.04,
  Wsc=0.025,
  Lpond=0.17,
  alpha=7,
  Lsep=0,
  rho_s=2720,
  rho_w=998,
  rho_o=870,
  eta_w=0.001,
  mu_s=0.25,
  phi_sed=0.45,
  phi_max=0.64,
  phi_ref=0.13,
  u_conv=0.57,
  bs=3,
  bw=2,
  rrsb=false), DataType="Bus: BusTricParams")

TricInputs0 = Simulink.Parameter(struct(
  eta_o=0.03,
  d50=3.0e-6,
  x50=1.5e-6,
  eps_s=0.02,
  eps_wd=0.08,
  eps_wf=0.3,
  eps_o=0.6,
  Rw=0.0287,
  Ro=0.028,
  Q=8.333333e-06,
  dn=10,
  C=1500), DataType="Bus: BusTricInputs")

m0 = repmat(0, 25, 1)
phi0 = repmat(0, 25, 40)
Ts = 1